# Grasshopper definition CityOfKnowledgeGIS.gh (Grasshopper 1.0.7)
# plug-ins: treesloth01, GHopperGIS

rungdal = RunGDALAndOGR()

# ----
# https://epsg.io/5472
number_slider = Slider(5472, range=0..10000)

lat_long_epsg_code = Slider(4326, range=0..10000)

# ---- group: BRect
panel = Panel("""9.012986
-79.570677""")
panel_2 = Panel("""8.987030
-79.598444""")
item = ListItem(List=panel_2, Index=0, Wrap=True)  # -> Item, Item1
item_2 = ListItem(List=panel, Index=0, Wrap=True)  # -> Item, Item1
pt = ConstructPoint(XCoordinate=item_2.Item1, YCoordinate=item_2.Item, ZCoordinate=0)
pt_2 = ConstructPoint(XCoordinate=item.Item1, YCoordinate=item.Item, ZCoordinate=0)
rec_2pt = Rectangle2Pt(Plane=PlaneXY(0, 0, 0), PointA=pt_2, PointB=pt, Radius=0)  # -> Rectangle, Length
rpjctgeo = ReprojectGeometry(GeometryIn=rec_2pt.Rectangle, CurrentEPSGCode=lat_long_epsg_code, DesiredEPSGCode=lat_long_epsg_code, UseTasks=False)
area = Area(Geometry=rpjctgeo, UseTasks=False)  # -> Area, Centroid
scale = Scale(Geometry=rec_2pt.Rectangle, Center=area.Centroid, Factor=Slider(4.232, range=0..10))  # -> Geometry, Transform
disc = Discontinuity(Curve=scale.Geometry, Level=1)  # -> Points, Parameters
item_3 = ListItem(List=disc.Points, Index=Slider(2, range=0..10), Wrap=True)
item_4 = ListItem(List=disc.Points, Index=0, Wrap=True)
pdecon = Deconstruct(Point=item_3)  # -> XComponent, YComponent, ZComponent
pdecon_2 = Deconstruct(Point=item_4)  # -> XComponent, YComponent, ZComponent
rec_2pt_2 = Rectangle2Pt(Plane=PlaneXY(0, 0, 0), PointA=item_4, PointB=item_3, Radius=0)  # -> Rectangle, Length
rhinotowkb = ConvertRhinoGeometryToWKB(GeometryIn=rec_2pt_2.Rectangle, UseTasks=False)  # -> WellKnownBinaryOut, WellKnownBinaryGeometryType
rpjctgeo_2 = ReprojectGeometry(GeometryIn=rec_2pt_2.Rectangle, CurrentEPSGCode=lat_long_epsg_code, DesiredEPSGCode=number_slider, UseTasks=False)
dom²num = ConstructDomain²(UMin=pdecon_2.YComponent, UMax=pdecon_2.XComponent, VMin=pdecon.YComponent, VMax=pdecon.XComponent)
panel_3 = Panel("CityOfKnowledgeDomain")
# ...\CityOfKnowledge\Data\Información_del_Censo_2010_por_Manzanas\Información_del_Censo_2010_por_Manzanas_1593019427294.shp
dom²num_2 = ConstructDomain²(UMin=item.Item1, UMax=item.Item, VMin=item_2.Item1, VMax=item_2.Item)

# ----
# ...\CityOfKnowledge\Data\OpenStreetMaps\CityOfKnowledge.osm
toggle = BooleanToggle(False)
txt = Text("D:\SSS\CityOfKnowledge\Data\OpenStreetMaps\CityOfKnowledge.osm")
open = OpenFile(Run=toggle)
getosm = DownloadOSM(OutputPaths=txt, _2DDomain=dom²num)  # disabled
# ...\CityOfKnowledge\Data\ET_Urbano\ET_Urbano_1593018356017.shp
toggle_2 = BooleanToggle(False)
open_2 = OpenFile(Run=toggle_2)
number_slider_2 = Slider(13, range=0..100)
# ...\CityOfKnowledge\Data\OpenStreetMaps\CityOfKnowledge.osm
toggle_3 = BooleanToggle(False)
txt_2 = Text("D:\SSS\CityOfKnowledge\Data\OpenStreetMaps\CityOfKnowledge.osm")
txt_3 = Text(open_2)
txt_4 = Text("D:\SSS\CityOfKnowledge\Data\ET_Urbano\Clipped\ET_Urbano_Clipped.shp")
open_3 = OpenFile(Run=toggle_3)
read_vec = ReadVector(PathToFile=txt_3, OutputEPSGCode=number_slider, SpatialFilter=rhinotowkb.WellKnownBinaryOut)  # -> GeometryOutput, CullPattern
vec_extr = VectorExtractor(PathToFile=open, FieldToSelect=Slider(24, range=0..25), LayerToSelect=number_slider_2)  # -> NumberOfFeatures, Layers, Fields, OutputField, GeometryType, Projection
read_vec_2 = ReadVector(PathToFile=open, LayerToSelect=number_slider_2, OutputEPSGCode=number_slider)  # -> GeometryOutput, CullPattern
open_4 = OpenFile(Run=Toggle(False))
# ...\CityOfKnowledge\Data\TerrenoRaster\Terreno.tif
toggle_4 = BooleanToggle(False)
worldori = TranslateToWorldOrigin(BboxIn=rpjctgeo_2, GeometryIn=read_vec.GeometryOutput)  # -> GeometryOut, InverseTransform
txt_5 = Text("D:\SSS\CityOfKnowledge\Data\Información_del_Censo_2010_por_Manzanas\Información_del_Censo_2010_por_Manzanas_1593019427294.shp")
txt_6 = Text(open_4)
open_5 = OpenFile(Run=toggle_4)
number_slider_3 = Slider(4, range=0..4)
txt_7 = Text("D:\SSS\CityOfKnowledge\Data\TerrenoRaster\TerrenoClipped.tif")  # disabled
read_vec_3 = ReadVector(PathToFile=txt_6, OutputEPSGCode=number_slider, SpatialFilter=rhinotowkb.WellKnownBinaryOut)  # -> GeometryOutput, CullPattern
worldori_2 = TranslateToWorldOrigin(BboxIn=rpjctgeo_2, GeometryIn=read_vec_2.GeometryOutput)  # -> flatten(GeometryOut), InverseTransform
txt_8 = Text("D:\SSS\CityOfKnowledge\Data\TerrenoRaster\Terreno.tif")  # disabled
attpickosm = AttributePickerOSM(FieldsIn=vec_extr.OutputField, AttributesIn="levels", PatternIn=Toggle(True), TagsOrData=Toggle(False))
gettopo = DownloadTopography(OutputPaths=txt_8, _2DDomain=dom²num, DataSource=1)  # disabled
gettopo_2 = DownloadTopography(OutputPaths=txt_7, _2DDomain=dom²num_2, DataSource=1)  # disabled
cls = Closed(Curve=worldori_2.GeometryOut)  # -> Closed, Periodic
nullrep = ReplaceNulls(Items=attpickosm, Replacements=Slider(1, range=0..1))  # -> Items, Count
worldori_3 = TranslateToWorldOrigin(BboxIn=rpjctgeo_2, GeometryIn=read_vec_3.GeometryOutput)  # -> GeometryOut, InverseTransform
cull = CullPattern(List=worldori_2.GeometryOut, CullPattern=cls.Closed)
read_rast = ReadRasterFileInfo(PathToFile=open_5)  # -> DataSet, CacheSize
vec_extr_2 = VectorExtractor(PathToFile=open_3, FieldToSelect=Slider(1, range=0..4), LayerToSelect=number_slider_3)  # -> NumberOfFeatures, Layers, Fields, OutputField, GeometryType, Projection
read_vec_4 = ReadVector(PathToFile=open_3, LayerToSelect=number_slider_3, OutputEPSGCode=number_slider)  # -> GeometryOutput, CullPattern
get_rast_coords = GetCoordinatesFromRasterFile(PathToFile=open_5)  # -> Latitude, Longitude, UCount, VCount, Projection
multiplication = Multiplication(A=nullrep.Items, B=Slider(3.9, range=0..10))
number_slider_4 = Slider(100000, range=0..100000)
area_2 = Area(Geometry=cull, UseTasks=False)  # -> Area, Centroid
len = Length(Curve=cull)
panel_4 = Panel(vec_extr_2.OutputField)
path_mapper = PathMapper(read_vec_4.GeometryOutput, source="{A;B}", target="{A}")
grid2data = MatchGridToData(ListOfData=get_rast_coords.Longitude, DataSet=read_rast.DataSet)
grid2data_2 = MatchGridToData(ListOfData=get_rast_coords.Latitude, DataSet=read_rast.DataSet)
filterbynulls = CSharpScript(GeoIn=path_mapper, FieldsIn=vec_extr_2.OutputField)  # -> out, A, B; inputs GeoIn: tree, FieldsIn: list
# ---------- filterbynulls: C# ----------
    DataTree<object> pattern = new DataTree<object>();
    DataTree<object> tree = new DataTree<object>();

    for( int i = 0; i < GeoIn.BranchCount; ++i )
    {

      string temp = (string) FieldsIn[i];
      GH_Path path = GeoIn.Path(i);

      if( temp.Length != 0 )
      {

        pattern.Add(temp, path);
        tree.AddRange(GeoIn.Branch(i), path);

      }

    }

    A = pattern;
    B = tree;
# ---------- end filterbynulls ----------
c_script = CSharpScript(areasIn=area_2.Area, maximum=Slider(100000, range=0..100000))  # -> out, A; inputs areasIn: tree of Double, maximum: Double
# ---------- c_script: C# ----------
    DataTree<bool> booleans = new DataTree<bool>();

    for( int i = 0; i < areasIn.BranchCount; ++i )
    {

      GH_Path path = areasIn.Path(i);

      for( int j = 0; j < areasIn.Branch(i).Count; ++j )
      {

        double tempArea = areasIn.Branch(i)[j];

        if( tempArea > maximum )
        {

          booleans.Add(false, path);

        }

        else
        {

          booleans.Add(true, path);

        }

      }

    }

    A = booleans;
# ---------- end c_script ----------
Z = UnitZ(Factor=Slider(-100, range=-100.1..-100))
cull_2 = CullPattern(List=multiplication, CullPattern=cls.Closed)
cls_2 = Closed(Curve=worldori.GeometryOut)  # -> Closed, Periodic
cls_3 = Closed(Curve=worldori_3.GeometryOut)  # -> Closed, Periodic
lng = ListLength(List=vec_extr_2.OutputField)
cull_3 = CullPattern(List=worldori.GeometryOut, CullPattern=cls_2.Closed)
worldori_4 = TranslateToWorldOrigin(BboxIn=rpjctgeo_2, GeometryIn=filterbynulls.B, UseTasks=False)  # -> GeometryOut, InverseTransform
prjcoords = ReprojectFromCoords(
    XCoordinate=grid2data_2,
    YCoordinate=grid2data,
    ZCoordinate=read_rast.DataSet,
    InputEPSG=get_rast_coords.Projection,
    OutputEPSG=number_slider)
cull_4 = CullPattern(List=worldori_3.GeometryOut, CullPattern=cls_3.Closed)
cull_5 = CullPattern(List=cull_2, CullPattern=c_script.A)
subtraction = Subtraction(A=get_rast_coords.UCount, B=1)
cull_6 = CullPattern(List=area_2.Centroid, CullPattern=c_script.A)
move = Move(Geometry=cull_6, Motion=Z)  # -> Geometry, Transform
# ...\CityOfKnowledge\Data\Rios\Rios.shp
toggle_5 = BooleanToggle(False)
cull_7 = CullPattern(List=cull, CullPattern=c_script.A)
# ...\CityOfKnowledge\Data\Lineas_de_metro\LineasDelMetro.shp
toggle_6 = BooleanToggle(False)
c_script_2 = CSharpScript(GeoIn=worldori_4.GeometryOut)  # -> out, CurvesOut, PointsOut; inputs GeoIn: tree
# ---------- c_script_2: C# ----------
    DataTree<Curve> Curves = new DataTree<Curve>();
    DataTree<Point3d> Points = new DataTree<Point3d>();
    
    for( int i = 0; i < GeoIn.BranchCount; ++i )
    {
      
      GH_Path path = GeoIn.Path(i);
     
      for( int j = 0; j < GeoIn.Branch(i).Count; ++j )
      {
      
        //Print( "Type: {0}:", GeoIn.Branch(i)[j].GetType() );
        var temp = GeoIn.Branch(i)[j];
        string type = temp.GetType().ToString();
        
        switch( type )
        {
        
          case "Rhino.Geometry.Point3d":
            Points.Add( ( Point3d ) temp, path );
            break;
          
          case "Rhino.Geometry.NurbsCurve":
            Curves.Add( ( Curve ) temp, path );
            break;
        
        }
      
      }
      
    }
    
    CurvesOut = Curves;
    PointsOut = Points;
# ---------- end c_script_2 ----------
Z_2 = UnitZ(Factor=1)
# ...\CityOfKnowledge\Data\vias_primarias\vias_primarias_1593011811477.shp
toggle_7 = BooleanToggle(False)
# ...\CityOfKnowledge\Data\RutasComerciales5000\RutasComerciales5000_1593018251065.shp
toggle_8 = BooleanToggle(False)
Z_3 = UnitZ(Factor=cull_5)  # -> simplify(graft(UnitVector))
area_3 = Area(Geometry=cull_3, UseTasks=False)  # -> Area, Centroid
area_4 = Area(Geometry=cull_4, UseTasks=False)  # -> Area, Centroid
open_6 = OpenFile(Run=toggle_5)
Z_4 = UnitZ(Factor=Slider(-100, range=-100.1..-100))
open_7 = OpenFile(Run=toggle_6)
open_8 = OpenFile(Run=toggle_7)
open_9 = OpenFile(Run=toggle_8)
Z_5 = UnitZ(Factor=Slider(-100, range=-100.1..-100))
ptmesh = MeshFromPoints(GridOfPoints=prjcoords, UParameter=subtraction, VParameter=get_rast_coords.VCount, Triangles=Toggle(True))
disc_2 = Discontinuity(Curve=cull_3, Level=1)  # -> Points, Parameters
join = JoinCurves(Curves=c_script_2.CurvesOut, Preserve=False)
disc_3 = Discontinuity(Curve=cull_4, Level=1)  # -> Points, Parameters
txt_9 = Text("\"D:\\SSS\\CityOfKnowledge\\Data\\Lineas_de_metro\\LineasDelMetro.shp\"")
txt_10 = Text(open_7)
txt_11 = Text("D:\SSS\CityOfKnowledge\Data\Rios\Rios.shp")
txt_12 = Text(open_6)
txt_13 = Text("D:\SSS\CityOfKnowledge\Data\RutasComerciales5000\RutasComerciales5000_1593018251065.shp")
txt_14 = Text(open_9)
txt_15 = Text("D:\SSS\CityOfKnowledge\Data\vias_primarias\vias_primarias_1593011811477.shp")
txt_16 = Text(open_8)
area_5 = Area(Geometry=join)  # -> Area, simplify(Centroid)
move_2 = Move(Geometry=disc_2.Points, Motion=Z_4)  # -> Geometry, Transform
move_3 = Move(Geometry=disc_3.Points, Motion=Z_5)  # -> Geometry, Transform
read_vec_5 = ReadVector(PathToFile=txt_10, OutputEPSGCode=number_slider)  # -> GeometryOutput, CullPattern
read_vec_6 = ReadVector(PathToFile=txt_12, OutputEPSGCode=number_slider, SpatialFilter=rhinotowkb.WellKnownBinaryOut)  # -> GeometryOutput, CullPattern
read_vec_7 = ReadVector(PathToFile=txt_14, OutputEPSGCode=number_slider)  # -> GeometryOutput, CullPattern
read_vec_8 = ReadVector(PathToFile=txt_16, OutputEPSGCode=number_slider)  # -> GeometryOutput, CullPattern
vec_extr_3 = VectorExtractor(PathToFile=txt_3, SpatialFilter=rhinotowkb.WellKnownBinaryOut)  # -> NumberOfFeatures, Layers, Fields, OutputField, GeometryType, Projection
merge = Merge(Data1=area_5.Centroid, Data2=simplify(c_script_2.PointsOut))
rpjctgeo_3 = ReprojectGeometry(GeometryIn=rec_2pt.Rectangle, CurrentEPSGCode=lat_long_epsg_code, DesiredEPSGCode=number_slider, UseTasks=False)
renumber = RenumberPaths(Data=filterbynulls.A)
vec_extr_4 = VectorExtractor(PathToFile=txt_6, SpatialFilter=rhinotowkb.WellKnownBinaryOut)  # -> NumberOfFeatures, Layers, Fields, OutputField, GeometryType, Projection
worldori_5 = TranslateToWorldOrigin(BboxIn=rpjctgeo_2, GeometryIn=ptmesh)  # -> GeometryOut, InverseTransform
meshray = MeshRay(Mesh=worldori_5.GeometryOut, Point=move.Geometry, Direction=Z_2)  # -> Point, Hit
subtraction_2 = Subtraction(A=simplify(meshray.Point), B=cull_6)
move_4 = Move(Geometry=cull_7, Motion=subtraction_2)  # -> graft(Geometry), Transform
Z_6 = UnitZ(Factor=1)
Z_7 = UnitZ(Factor=1)
boundary = BoundarySurfaces(Edges=simplify(move_4.Geometry))
tag = TextTag(Location=merge, Text=renumber)
meshray_2 = MeshRay(Mesh=worldori_5.GeometryOut, Point=move_2.Geometry, Direction=Z_6)  # -> Point, Hit
worldori_6 = TranslateToWorldOrigin(BboxIn=rpjctgeo_2, GeometryIn=read_vec_5.GeometryOutput)  # -> GeometryOut, InverseTransform
meshray_3 = MeshRay(Mesh=worldori_5.GeometryOut, Point=move_3.Geometry, Direction=Z_7)  # -> Point, Hit
panel_5 = Panel(renumber)
worldori_7 = TranslateToWorldOrigin(BboxIn=rpjctgeo_2, GeometryIn=read_vec_6.GeometryOutput)  # -> GeometryOut, InverseTransform
worldori_8 = TranslateToWorldOrigin(BboxIn=rpjctgeo_2, GeometryIn=read_vec_7.GeometryOutput)  # -> GeometryOut, InverseTransform
worldori_9 = TranslateToWorldOrigin(BboxIn=rpjctgeo_2, GeometryIn=read_vec_8.GeometryOutput)  # -> GeometryOut, InverseTransform
panel_6 = Panel(vec_extr_3.Fields)
worldori_10 = TranslateToWorldOrigin(BboxIn=rpjctgeo_2, GeometryIn=rpjctgeo_3)  # -> GeometryOut, InverseTransform
extr = Extrude(Base=boundary, Direction=Z_3)
pline = PolyLine(Vertices=meshray_2.Point, Closed=True)
panel_7 = Panel(vec_extr_4.Fields)
pline_2 = PolyLine(Vertices=meshray_3.Point, Closed=True)
